# Grasshopper definition Generic_anchors_ifc.gh (Grasshopper 1.0.7)
# plug-ins: ggRhinoIFC, Pufferfish, LunchBox

gggrasshoppersettings = GgGrasshopperSettings(
    SettingsData_IFCSettings_Format="STEP",
    SettingsData_IFCSettings_GenerateOwnerHistory=True,
    SettingsData_IFCSettings_IdentifyObsolete=False,
    SettingsData_IFCSettings_LastUsedUnits="None",
    SettingsData_IFCSettings_ModelViewDefinition="Ifc2x3Coordination",
    SettingsData_IFCSettings_PluginVersion="25.6.5.7",
    SettingsData_IFCSettings_Radians=True,
    SettingsData_RevitSettings_Format="STEP",
    SettingsData_RevitSettings_GenerateOwnerHistory=True,
    SettingsData_RevitSettings_IdentifyObsolete=True,
    SettingsData_RevitSettings_LastUsedUnits="None",
    SettingsData_RevitSettings_ModelViewDefinition="Ifc4DesignTransfer",
    SettingsData_RevitSettings_PluginVersion="25.6.5.7",
    SettingsData_RevitSettings_Radians=True)

# ----
# Step 1: Project-specific information
read_excel = BooleanToggle(False)
# INPUT
site_name = Panel("Anchor Modelling Paper")
excel_path = Panel("C:\...\Psets.xlsx")
lod = ValueList({"LOD100": 0, "LOD200": 1, "LOD300": 2, "LOD350": 3, "LOD400": 4, "LOD500": 5}, selected="LOD500")

# ----
# Step 2: Overriding property names for each LOD
# - non-overriding property values to be assigned in the excel sheet
# - overriding property values to be assigned in this Grasshopper script
overriding_property_names_lod300 = Panel("""Length
ID
Azimuth
Inclination
Element head X-coordinate
Element head Y-coordinate
Element head Z-coordinate""")
overriding_property_names_lod400 = Panel("""Length
ID
Azimuth
Inclination
Element head X-coordinate
Element head Y-coordinate
Element head Z-coordinate
Proof load test recommended""")
overriding_property_names_lod500 = Panel("""Length
ID
Azimuth
Inclination
Element head X-coordinate
Element head Y-coordinate
Element head Z-coordinate
Failure test recommended
Failure test
Failure test force
Proof load test recommended
Proof load test
Proof load test force""")
overriding_property_names_lod100 = Panel("")
overriding_property_names_lod200 = Panel("")
overriding_property_names_lod350 = Panel("""Length
ID
Azimuth
Inclination
Element head X-coordinate
Element head Y-coordinate
Element head Z-coordinate""")

object_name = Panel(" bolts")

# ----
# INFORMATION FROM EXCEL
# Worksheet name
panel = Panel("""LOD100
LOD200
LOD300
LOD350
LOD400
LOD500""")
list_item = ListItem(List=panel, Index=lod, Wrap=True)
panel_2 = Panel(list_item)

# ----
# Add LOD# to Object name
panel_3 = Panel(" ")
concatenate = Concatenate(Fragment_A=list_item, A=panel_3, Fragment_B=object_name)

# ----
# Overriding property names
stream_filter = StreamFilter(
    Gate=lod,
    Stream0=overriding_property_names_lod100,
    Stream1=overriding_property_names_lod200,
    Stream2=overriding_property_names_lod300,
    Stream3=overriding_property_names_lod350,
    Stream4=overriding_property_names_lod400,
    Stream5=overriding_property_names_lod500)
panel_4 = Panel(stream_filter)

# ----
# CREATE IFC
# Create IFC-project
ggifc_project = GgIFCProject(Name=site_name)
ggifc_site = GgIFCSite(Host=ggifc_project, Name=site_name, Type=2, ReferenceElevation=0)
ggifc_building = GgIFCBuilding(ContainerIFCSiteOrBuilding=ggifc_site, Name=site_name, LongName="GH Building", BuildingComposition=0)

# ----
# GEOMETRY
# Geometry (internalised)
lod100_brep = Brep(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)
lod200_brep = Brep(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)
lod350_curve = Curve([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])
lod400_curve = Curve([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])
lod500_curve = Curve([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])
lod300_curve = Curve([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])
ggifc_geometryconvertoptions = GgIFCGeometryConvertOptions(Merge=False, Voids=False, Extrusion=True, Advanced=False, Sweeps=False, FaceBased=True)
ggifc_geometry = GgIFCGeometry(BrepOrMesh=lod100_brep, Options=ggifc_geometryconvertoptions)
ggifc_geometry_2 = GgIFCGeometry(BrepOrMesh=lod200_brep, Options=ggifc_geometryconvertoptions)
ggifc_curve = GgIFCCurve(Curve=lod300_curve)
ggifc_curve_2 = GgIFCCurve(Curve=lod350_curve)
ggifc_curve_3 = GgIFCCurve(Curve=lod400_curve)
ggifc_curve_4 = GgIFCCurve(Curve=lod500_curve)

stream_filter_2 = StreamFilter(
    Gate=lod,
    Stream0=lod100_brep,
    Stream1=lod200_brep,
    Stream2=lod300_curve,
    Stream3=lod350_curve,
    Stream4=lod400_curve,
    Stream5=lod500_curve)
geometry = Geometry(stream_filter_2)

stream_filter_3 = StreamFilter(
    Gate=lod,
    Stream0=ggifc_geometry,
    Stream1=ggifc_geometry_2,
    Stream2=ggifc_curve,
    Stream3=ggifc_curve_2,
    Stream4=ggifc_curve_3,
    Stream5=ggifc_curve_4)

geometry_representation = Geometry(stream_filter_3)

# ----
# INFORMATION EXTRACTED FROM GEOMETRY
# Get variable property values based on Rhino curve geometry
length = Length(Curve=geometry)
proof_load_test_passed_failed_not_tested = Panel("""Not tested
Passed
Passed
Not tested
Passed
Passed
Not tested
Not tested
Passed
Not tested
Passed
Passed
Not tested
Not tested
Not tested
Passed
Not tested
Passed
Not tested
Not tested
Not tested
Passed
Passed
Not tested
Not tested""")
failure_test_tested_not_tested = Panel("""Not tested
Not tested
Not tested
Not tested
Not tested
Not tested
Not tested
Not tested
Not tested
Not tested
Not tested
Not tested
Not tested
Not tested
Not tested
Not tested
Not tested
Tested
Not tested
Not tested
Not tested
Not tested
Tested
Not tested
Not tested""")
failure_test_force_kn = Panel("""0
0
0
0
0
0
0
0
0
0
0
0
0
0
0
0
0
402
0
0
0
0
380
0
0""")

# ---- group: ID
list_indices = ListIndices(List=geometry)

# ---- group: Azimuth
xy_plane = XYPlane(Origin=Point(0, 0, 0))
unit_y = UnitY(Factor=1)
vector = Vector(geometry)
angle = Angle(VectorA=vector, VectorB=unit_y, Plane=xy_plane)  # -> Angle, Reflex
degrees = Degrees(Radians=angle.Angle)

# ---- group: Inclination
unit_z = UnitZ(Factor=1)
vector_2 = Vector(geometry)
xy_plane_2 = XYPlane(Origin=Point(0, 0, 0))
project = Project(Geometry=vector_2, Plane=xy_plane_2)  # -> Geometry, Transform
construct_plane = ConstructPlane(Origin=Point(0, 0, 0), XAxis=project.Geometry, YAxis=unit_z)
angle_2 = Angle(VectorA=vector_2, VectorB=project.Geometry, Plane=construct_plane)  # -> Angle, Reflex
degrees_2 = Degrees(Radians=angle_2.Angle)

# ---- group: Bolt head X, Y, Z-coordinates
end_points = EndPoints(Curve=geometry)  # -> Start, End
deconstruct = Deconstruct(Point=end_points.Start)  # -> XComponent, YComponent, ZComponent

# ---- group: Failure test (recommended)
list_indices_2 = ListIndices(List=geometry)
random_split_list = RandomSplitList(MasterList=list_indices_2, Seed="42", Split="0.1")  # -> ListA, ListB
list_length = ListLength(List=list_indices_2)
duplicate_data = DuplicateData(Data="False", Number=list_length, Order=True)
replace_items = ReplaceItems(List=duplicate_data, Item="True", Indices=random_split_list.ListB, Wrap=False)

# ---- group: Proof load test recommended
list_indices_3 = ListIndices(List=geometry)
random_split_list_2 = RandomSplitList(MasterList=list_indices_3, Seed="42", Split="0.3")  # -> ListA, ListB
list_length_2 = ListLength(List=list_indices_3)
duplicate_data_2 = DuplicateData(Data="False", Number=list_length_2, Order=True)
replace_items_2 = ReplaceItems(List=duplicate_data_2, Item="True", Indices=random_split_list_2.ListB, Wrap=False)

# ---- group: Proof test force
proof_force_kn = Panel("160")
duplicate_data_3 = DuplicateData(Data="0", Number=list_length, Order=True)
duplicate_data_4 = DuplicateData(Data=proof_force_kn, Number=list_length, Order=True)
pick_n_choose = PickNChoose(Pattern=replace_items_2, Stream0=duplicate_data_3, Stream1=duplicate_data_4)

# ---- group: Overriding property values - LOD300
entwine = Entwine(
    Branch00=length,
    Branch01=list_indices,
    Branch02=degrees,
    Branch03=degrees_2,
    Branch04=deconstruct.XComponent,
    Branch05=deconstruct.YComponent,
    Branch06=deconstruct.ZComponent,
    FlattenInputs=True)  # -> simplify(Result)

# ---- group: Overriding property values - LOD350
entwine_2 = Entwine(
    Branch00=length,
    Branch01=list_indices,
    Branch02=degrees,
    Branch03=degrees_2,
    Branch04=deconstruct.XComponent,
    Branch05=deconstruct.YComponent,
    Branch06=deconstruct.ZComponent,
    FlattenInputs=True)  # -> simplify(Result)

# ---- group: Overriding property values - LOD400
entwine_3 = Entwine(
    Branch00=length,
    Branch01=list_indices,
    Branch02=degrees,
    Branch03=degrees_2,
    Branch04=deconstruct.XComponent,
    Branch05=deconstruct.YComponent,
    Branch06=deconstruct.ZComponent,
    Branch07=replace_items_2,
    FlattenInputs=True)  # -> simplify(Result)

# ---- group: Overriding property values - LOD500
entwine_4 = Entwine(
    Branch00=length,
    Branch01=list_indices,
    Branch02=degrees,
    Branch03=degrees_2,
    Branch04=deconstruct.XComponent,
    Branch05=deconstruct.YComponent,
    Branch06=deconstruct.ZComponent,
    Branch07=replace_items,
    Branch08=failure_test_tested_not_tested,
    Branch09=failure_test_force_kn,
    Branch010=replace_items_2,
    Branch011=proof_load_test_passed_failed_not_tested,
    Branch012=pick_n_choose,
    FlattenInputs=True)  # -> simplify(Result)

# ----
# Overriding property value
stream_filter_4 = StreamFilter(Gate=lod, Stream2=entwine, Stream3=entwine_2, Stream4=entwine_3, Stream5=entwine_4)
panel_5 = Panel(stream_filter_4)

# ----
# IfcPropSingleValue & IfcPropSet
list_length_3 = ListLength(List=geometry)
number_of_objects = Integer(list_length_3)
ifcpropsinglevalue_generator = IfcPropSingleValueGenerator(
    read_excel=read_excel,
    path=excel_path,
    worksheet=list_item,
    overriding_property_names=stream_filter,
    overriding_property_value_simplified_tre=stream_filter_4,
    number_of_objects=number_of_objects)
duplicate_data_5 = DuplicateData(Data=concatenate, Number=number_of_objects, Order=True)  # -> simplify(graft(Data))
ggifc_propertyset = GgIFCPropertySet(Name=duplicate_data_5, IfcProperties=ifcpropsinglevalue_generator)
panel_6 = Panel(ifcpropsinglevalue_generator)

# ----
# IfcProduct
ggifc_product = GgIFCProduct(Host=ggifc_building, Type="IfcProxy", Name=concatenate, Representation=geometry_representation)  # -> simplify(graft(IfcProduct))

# ----
# Step 3: Assign properties and geometries
# and export to IFC: Double click >>
ggifc_assign_properties = GgIFCAssignProperties(IfcPropSet=ggifc_propertyset, Objects=ggifc_product)
ggifc_baketofile = GgIFCBaketoFile(ggifc_assign_properties)

# ==== cluster IfcPropSingleValueGenerator
read_excel = ClusterInput()
path = ClusterInput()
worksheet = ClusterInput()
overriding_property_names = ClusterInput()
overriding_property_value_simplified_tre = ClusterInput()  # "Overriding property value (simplified tree)"
number_of_objects = ClusterInput()

# ----
# Read property names and pre-filled property values from Excel
read_excel_2 = Boolean(read_excel)
excelread = ExcelReader(ReadExcelData=read_excel_2, WorkbookPath=path, WorksheetName=worksheet)  # -> Exceptions, ExcelData
excel_2_pset = GhPythonScript(excel_content=excelread.ExcelData)  # -> out, property_names, property_data_type, property_values; inputs excel_content: tree
# ---------- excel_2_pset: Python ----------
__author__ = "GEr"
__version__ = "2023.04.05"


property_names = [x for x in excel_content.Branch(0)[1:]]
property_data_type = [x for x in excel_content.Branch(1)[1:]]
property_values = [x for x in excel_content.Branch(2)[1:]]
# ---------- end excel_2_pset ----------
panel = Panel(excelread.ExcelData)

# ----
# Collect varied property values
overriding_property_value_simplified_tre_2 = Data(overriding_property_value_simplified_tre)  # "Overriding property value (simplified tree)"
flip_matrix = FlipMatrix(Data=overriding_property_value_simplified_tre_2)
varied_property_values = Data(flip_matrix)

overriding_property_names_2 = Text(overriding_property_names)

# ----
# Create a nested list (tree) of property values
number_of_objects_2 = Integer(number_of_objects)
pre_filled_property_values = Data(excel_2_pset.property_values)
property_names = Data(excel_2_pset.property_names)
varied_property_values_2 = Data(varied_property_values)
data_type = Text(excel_2_pset.property_data_type)

# ---- group: Get list indices with varied property values
match_text = MatchText(Text=simplify(graft(overriding_property_names_2)), Pattern=property_names, Case=True)
list_indices = ListIndices(List=property_names)
cull_pattern = CullPattern(List=list_indices, CullPattern=match_text)  # -> flatten(List)

# ---- group: Create a nested list (tree) of property names
stack_data = StackData(Data=graft(property_names), Stack=number_of_objects_2)  # -> simplify(Data)
flip_matrix_2 = FlipMatrix(Data=stack_data)

# ---- group: Create a nested list (tree) of pre-filled property values
stack_data_2 = StackData(Data=graft(pre_filled_property_values), Stack=number_of_objects_2)  # -> simplify(Data)
flip_matrix_3 = FlipMatrix(Data=stack_data_2)

# ---- group: Create a nested list (tree) of data type
stack_data_3 = StackData(Data=graft(data_type), Stack=number_of_objects_2)  # -> simplify(Data)
flip_matrix_4 = FlipMatrix(Data=stack_data_3)

# ---- group: Replace empty items with varied property values
replace_items = ReplaceItems(List=flip_matrix_3, Item=varied_property_values_2, Indices=cull_pattern, Wrap=False)  # -> simplify(List)

# ----
property_names_2 = Panel(flip_matrix_2)
property_values = Data(replace_items)
property_values_2 = Panel(replace_items)

# ----
# Create IfcPropSingleValue
ggifc_diverse_types = GgIFCDiverseTypes(value=property_values, data_type=flip_matrix_4)
panel_2 = Panel(ggifc_diverse_types)
ggifc_propertysinglevalue = GgIFCPropertySingleValue(Name=flip_matrix_2, IfcValue=ggifc_diverse_types)
panel_3 = Panel(ggifc_propertysinglevalue)
ifcpropsinglevalue = Data(ggifc_propertysinglevalue)

ifcpropsinglevalue_2 = ClusterOutput(ifcpropsinglevalue)

# ==== cluster GgIFCDiverseTypes
value = ClusterInput()
data_type = ClusterInput()
value_2 = Data(value)
ggifc_boolean = GgIFCBoolean(Boolean=value_2)
data_type_2 = Text(data_type)
ggifc_real = GgIFCReal(Number=value_2)
ggifc_integer = GgIFCInteger(Integer=value_2)
ggifc_text = GgIFCText(String=value_2)
match_text = MatchText(Text=data_type_2, Pattern="Boolean", Case=True)
match_text_2 = MatchText(Text=data_type_2, Pattern="Real", Case=True)
match_text_3 = MatchText(Text=data_type_2, Pattern="Integer", Case=True)
match_text_4 = MatchText(Text=data_type_2, Pattern="Text", Case=True)
multiplication = Multiplication(A=match_text, B="1")  # -> graft(Result)
multiplication_2 = Multiplication(A=match_text_2, B="2")  # -> graft(Result)
multiplication_3 = Multiplication(A=match_text_3, B="3")  # -> graft(Result)
multiplication_4 = Multiplication(A=match_text_4, B="4")  # -> graft(Result)
# Boolean = 1
# Real    = 2
# Integer = 3
# Text    = 4
mass_addition = MassAddition(Input=[multiplication, multiplication_2, multiplication_3, multiplication_4])  # -> simplify(Result), PartialResults

# ---- group: Ensure the input and output has same tree structure
tree_statistics = TreeStatistics(Tree=data_type_2)  # -> Paths, Length, Count
duplicate_data = DuplicateData(Data=graft(tree_statistics.Paths), Number=graft(tree_statistics.Length), Order=True)  # -> flatten(Data)
create_tree = CreateTree(Data=mass_addition.Result, Path=duplicate_data)

# ---- group: Convert empty attribute to data type as TEXT
list_indices = ListIndices(List=value_2)
text_length = TextLength(Text=value_2)
cull_pattern = CullPattern(List=list_indices, CullPattern=invert(text_length))
replace_items = ReplaceItems(List=create_tree, Item="4", Indices=cull_pattern, Wrap=False)

# ----
pick_n_choose = PickNChoose(
    Pattern=replace_items,
    Stream0=ggifc_real,
    Stream1=ggifc_boolean,
    Stream2=ggifc_real,
    Stream3=ggifc_integer,
    Stream4=ggifc_text)

# ---- group: Ensure the input and output has same tree structure
tree_statistics_2 = TreeStatistics(Tree=value_2)  # -> Paths, Length, Count
duplicate_data_2 = DuplicateData(Data=graft(tree_statistics_2.Paths), Number=graft(tree_statistics_2.Length), Order=True)  # -> flatten(Data)
create_tree_2 = CreateTree(Data=pick_n_choose, Path=duplicate_data_2)

# ----
ggifc_value = Data(create_tree_2)
ggifc_value_2 = ClusterOutput(ggifc_value)
